# Grasshopper definition OffsetOutter.gh (Grasshopper 1.0.7)

crv = Curve(<curve referenced from the Rhino model>)
distance = Slider(10, range=0..10)
offset_outter = GhPythonScript(Crv=crv, D=distance)  # -> C
# ---------- offset_outter: Python ----------
__author__ = "sjak3"
__version__ = "2021.12.07"

import rhinoscriptsyntax as rs
obj = Crv
if rs.IsCurve(obj):
    a = rs.OffsetCurve( obj, [0,0,0], 0.01 )
    A_1 = rs.CurveArea(obj)                     #A_1 is original crv.
    A_2 = rs.CurveArea(a)                       #A_2 is Offsetted crv.
    if(A_2 >=  A_1):
        C = rs.OffsetCurve(obj, [0,0,0], D)
    else :                                      
        d2 = D*(-1)
        C = rs.OffsetCurve(obj, [0,0,0], d2)
        
       
       
#If offsetted crv is larger than original one, there is no need to flip crv.
#Otherwise, Crv needs to be flipped.
#Comparison Crv (a) is offsetted 0.01.
# ---------- end offset_outter ----------
crv_2 = Curve(offset_outter)
